vi "Interpret_Software_Version_History.gviweb"   [G Web Development Software 22.3.0]
inputs:
  "Diagnostic Service History Entrys": string[]
  "Device Type": string = "Device"
  "Error Cluster input": error
outputs:
  "Software Version History": T1[]
  "Error Output": error
types:
  T1 = cluster{"Parameter Name": string, "Date": string, "Date_2": string}
  T2 = cluster{"Parameter Name": string, "Date": string, "Software Version": string}
uses:
  NI::G Core::Strings::Trim Whitespace.gvi
  NI::G Core::Strings::Search and Replace Pattern.gvi
  WebApp::Change_to_validate_Date.gvi
diagram:
  for {
    w1 = each element of $"Diagnostic Service History Entrys"
    Match Pattern(regular expression="Update_Date=", string=w1) -> (after substring=w3, before substring=w4)
    call "Trim Whitespace.gvi"(string=w4) -> (trimmed string=w5)
    Match Pattern(regular expression="Version_Name=", string=w3) -> (after substring=w6, before substring=w7)
    call "Search and Replace Pattern.gvi"(String=w6, Muster="\"", Alle ersetzen=TRUE) -> (Ergebnis-String=w8)
    call "Trim Whitespace.gvi"(string=w8) -> (trimmed string=w9)
    call "Search and Replace Pattern.gvi"(String=w7, Muster="\"", Alle ersetzen=TRUE) -> (Ergebnis-String=w10)
    call "Trim Whitespace.gvi"(string=w10) -> (trimmed string=w11)
    call "Change_to_validate_Date.gvi"(Date_Time_String input=w11, Error Cluster input=$"Error Cluster input") -> (Validate date and time=w12, Error Cluster output=w13)
    Property Node(instance in=T2 {all zero or empty}, "Parameter Name"=w5, "Date"=w12, "Software Version"=w9) -> (instance out=w14)
    append w14 to w2
  }
  $"Error Output" <- w13
  $"Software Version History" <- w2
