vi "Sort_Common_Infomation.gviweb"   [G Web Development Software 22.3.0]
inputs:
  "Input Error": error
  "Error_Selektor": enum{"All data", "Relevant data", "Error view"} = "All data"
  "Common Information": T1[]
outputs:
  "Output Error": error
  "Output": T1[]
  "Common Information_Error": string
types:
  T1 = cluster{"Parameter Name": string, "Value": string, "Comment": string}
diagram:
  # [ℹ] Information is not implemented for this device, [ℹ] Information not required for this device type, [ℹ]  UltraVent is not implemented for this device !, [ℹ] Information is not required for this device
  case ($Error_Selektor) {
    frame "All data", Default {
      w1 = $"Input Error"
      w2 = $"Common Information"
      w3 = ""
    }
    frame "Error view" {
      s1 = T1[] []  # shift register
      s2 = ""  # shift register
      for {
        w4 = each element of $"Common Information"
        Property Node(instance in=w4) -> ("Comment"=w5, instance out=w6)
        Match Pattern(regular expression="❌", string=w5) -> (match substring=w7)
        case (w7) {
          frame "False", Default {
            w8 = s1
            w9 = s2
          }
          frame "❌" {
            Insert Into Array(inArray=s1, new=w6) -> w8
            w9 = "- Common Information"
          }
        }
        next s1 = w8
        next s2 = w9
      }
      w1 = $"Input Error"
      w2 = s1
      w3 = s2
    }
    frame "Relevant data" {
      s3 = T1[] []  # shift register
      for {
        w10 = each element of $"Common Information"
        Property Node(instance in=w10) -> ("Comment"=w11, instance out=w12)
        case (w11) {
          frame "[ℹ]  UltraVent is not implemented for this device !", "[ℹ] Information is not implemented for this device", "[ℹ] Information is not required for this device", "[ℹ] Information not required for this device type" {
            w13 = s3
          }
          frame "False", Default {
            Insert Into Array(inArray=s3, new=w12) -> w13
          }
        }
        next s3 = w13
      }
      w1 = $"Input Error"
      w2 = s3
      w3 = ""
    }
  }
  $"Common Information_Error" <- w3
  $Output <- w2
  $"Output Error" <- w1
