vi "Sort_Diagnostic_Real_Time_Data_Sensors.gviweb"   [G Web Development Software 22.3.0]
inputs:
  "Error_Selektor": enum{"All data", "Relevant data", "Error view"} = "All data"
  "Input Error": error
  "Diagnostic_RT_Data_Sensors": T1[]
outputs:
  "Output": T2[]
  "Output Error": error
  "Diagnostic Real Time Data Sensors": string
types:
  T1 = cluster{"Parameter Name": string, "Actual": string, "Dimension": string, "Limit": string, "maximum": string, "Time_stamp": string, "Comment": string}
  T2 = cluster{"Parameter Name": string, "Actual": string, "Dimension": string, "Limit": string, "maximum": string, "Element 6": string, "Element 7": string}
  T3 = cluster{"Parameter Name": string, "Actual": string, "Dimension": string, "Limit": string, "maximum": string, "time_stamp": string, "comment": string}
diagram:
  # [ℹ] Information is not implemented for this device, [ℹ] Information not required for this device type, [ℹ] Information is missing for this device type
  case ($Error_Selektor) {
    frame "All data", Default {
      w1 = $"Input Error"
      w2 = $Diagnostic_RT_Data_Sensors
      w3 = ""
    }
    frame "Error view" {
      s1 = T3[] []  # shift register
      s2 = ""  # shift register
      for {
        w4 = each element of $Diagnostic_RT_Data_Sensors
        Property Node(instance in=w4) -> ("Comment"=w5, instance out=w6)
        Match Pattern(regular expression="❌", string=w5) -> (match substring=w7)
        case (w7) {
          frame "False", Default {
            w8 = s1
            w9 = s2
          }
          frame "❌" {
            Insert Into Array(inArray=s1, new=w6) -> w8
            w9 = "- Diagnostic Real Time Data Sensors  "
          }
        }
        next s1 = w8
        next s2 = w9
      }
      w1 = $"Input Error"
      w2 = s1
      w3 = s2
    }
    frame "Relevant data" {
      s3 = T3[] []  # shift register
      for {
        w10 = each element of $Diagnostic_RT_Data_Sensors
        Property Node(instance in=w10) -> ("Comment"=w11, instance out=w12)
        case (w11) {
          frame "[ℹ] Information is missing for this device type", "[ℹ] Information is not implemented for this device", "[ℹ] Information not required for this device type" {
            w13 = s3
          }
          frame "False", Default {
            Insert Into Array(inArray=s3, new=w12) -> w13
          }
        }
        next s3 = w13
      }
      w1 = $"Input Error"
      w2 = s3
      w3 = ""
    }
  }
  $Output <- w2
  $"Diagnostic Real Time Data Sensors" <- w3
  $"Output Error" <- w1
