vi "index.gviweb"   [G Web Development Software 22.3.0]
# Press “Analyse” and select a service report xml file
panel controls:
  "Analyse": bool  # Press the button “Analyse” and select a service report xml file.
  "Page 1": i32
  "Page selector": enum{"Page 1", "Page 2", "Page 3", "Page 4"} = "Page 1"
  "Page 2": i32
  "Page 3": i32
  "Page 4": i32
  "Device": enum{"iCombi Pro/iHexagon", "iVario"} = "iCombi Pro/iHexagon"
  "ivario": i32
  "Info_Plot": bool
  "Sort table ivario": bool
  "Sort table iCombi": bool
  "Page content": bool
  "Engine Link": string = "https://portal.rational-online.com/fs4p/media/service/3_dokumentationen/icombi_pro___icombi_classik/tm_icombi_pro___icombi_classic/en_gb/80.51.321_ET_en-GB.pdf"
  "Changed Component": string[]
  "Error_Selektor": enum{"All data", "Relevant data", "Error view"} = "Relevant data"
  "Device:_2": string = "No_Picture.jpg"
  "Board Information:_2": cluster{"Board": string, "Information": string}[]
  "common_2": T1[]
  "Basic_Settings_2": T2[]
  "Diagnostic_RT_Data_Sensors_2": T9[]
  "Diagnostic RT Calibration_2": T3[]
  "Checkbox_2": bool
  "Diagnostic_Water_iCS_Switch_2": T4[]
  "Diagnostic-Service-History_2": T5[]
  "Sort table iCombi_2": bool
  "Engine Link_2": string = "https://portal.rational-online.com/fs4p/media/service/3_dokumentationen/icombi_pro___icombi_classik/tm_icombi_pro___icombi_classic/en_gb/80.51.321_ET_en-GB.pdf"
  "Diagnostic Running Times Comp_2": T6[]
  "Total Running Time :_2": T6[]
  "Software-Service-History_iCP_2": T11[]
  "Next page": bool
  "Previous page": bool
panel indicators:
  "Device:": string
  "Board Information:": cluster{"Board": string, "Information": string}[]
  "common": T1[]
  "URL-Grafik": string
  "Basic_Settings": T2[]
  "Diagnostic RT Calibration": T3[]
  "Checkbox": bool
  "Diagnostic_Water_iCS_Switch": T4[]
  "Diagnostic-Service-History": T5[]
  "Diagnostic Running Times Comp": T6[]
  "Diagnostic Running Times Modes": T6[]
  "System Logger Output": T7[]
  "Histogram cpu pcb Temperature profile Celsius": f64[]
  "skala histogram CPU": string
  "Histogram IO Temperature profile Celsius": f64[]
  "skala histogram IO": string
  "Histogram LED hinge side Temperature profile Celsius": f64[]
  "skala Histogram LED hinge": string
  "Histogram LED handle side Temperature profile Celsius": f64[]
  "Skala Histogram LED handle": string
  "Histogram pump pcb Temperature profile Celsius": f64[]
  "skala Histogram pump pcb": string
  "Histogram gas box Temperature profile Celsius": f64[]
  "Skala Histogram Gas box": string
  "Histogram fan 1 RPM profile 1 min": f64[]
  "skala Histogram fan 1 rpm": string
  "Histogram fan 1 power profile W": f64[]
  "Skala Histogram fan power": string
  "Histogram fan 1 Temperature_profile Celsius": f64[]
  "Skala Histogram fan1 temp": string
  "Histogram fan 1 Voltage max_V_1phase_3phase": f64[]
  "Skala Histogram fan1 max Volt": string
  "Histogram fan 1 Voltage min_V_1phase_3phase": f64[]
  "Skala Histogram fan1 minVolt": string
  "Histogram fan 2 RPM profile 1 min": f64[]
  "skala Histogram fan 2 rpm": string
  "Histogram fan 2 power profile W": f64[]
  "Skala Histogram fan2 power": string
  "Histogram fan 2 Temperature_profile Celsius": f64[]
  "Skala Histogram fan2 temp": string
  "Histogram fan 2 Voltage max_V_1phase_3phase": f64[]
  "Histogram fan 2 Voltage min_V_1phase_3phase": f64[]
  "Skala Histogram fan2 minVolt": string
  "Skala Histogram fan2 maxVolt": string
  "Histogram fan 3 RPM profile 1 min": f64[]
  "skala Histogram fan 3 rpm": string
  "Histogram fan 3 power profile W": f64[]
  "Skala Histogram fan3 power": string
  "Histogram fan 3 Temperature_profile Celsius": f64[]
  "Skala Histogram fan3 temp": string
  "Histogram fan 3 Voltage max_V_1phase_3phase": f64[]
  "Histogram fan 3 Voltage min_V_1phase_3phase": f64[]
  "Skala Histogram fan3 minVolt": string
  "Skala Histogram fan3 maxVolt": string
  "Histogram MMI CPU Load Percent": f64[]
  "Skala Histogram MMI CPU": string
  "Histogram MMI RAM Load Percent": f64[]
  "Skala Histogram MMI Load": string
  "Histogram Basis CPU Load Percent": f64[]
  "Skala Histogram Basis MMI CPU": string
  "Histogram Basis RAM Load Percent": f64[]
  "Skala Histogram Basis MMI Load": string
  "Histogram Magnetron Top Temperatur profile Celsius": f64[]
  "skala Magnetron top": string
  "Histogram Magnetron bottom Temperature profile Celsius": f64[]
  "skala Magnetron bottom": string
  "Histogram Power Supply Top Temperature profile Celsius": f64[]
  "skala Power Supply top": string
  "Histogram Power Supply bottom Temperature profile Celsius": f64[]
  "skala histogram Power Supply bottom": string
  "Boards_Information:": cluster{"Board": string, "Information": string}[]
  "Device :": string
  "common Information ivario": T1[]
  "Basic Informations": T2[]
  "Diagnostic_RT_Data_Sensors_Heating": T8[]
  "Diagnostic_RT_Data_Sensors": T9[]
  "Diagnostic_RT_Data_Sensors_mouvement": T10[]
  "Diagnostic_RT_Data_Sensors_Pressure": T4[]
  "Diagnostic-Service-History_iVario": T5[]
  "Total Running Time:": T6[]
  "Diagnostic Running Times Components:": T6[]
  "String": string
  "Total Running Time :": T6[]
  "Measured_temperature IO °C [Min/Max]:": f64[]
  "wrong unit type": bool
  "Software-Service-History_iCP": T11[]
  "Software-Service-History_iVario": T11[]
  "Component Replacement History": T12[]
  "add BMK to common information": bool
  "Tabs with errors": string
  "Common Information_Error": string
  "Basic_Settings_Error": string
  "Diagnostic Real Time Data Sensors": string
  "Diagnostic RT Calibration_Text": string
  "Diagnostic Water iCS Switch Text": string
  "Diagnostic Service History Text": string
  "Diagnostic RunningTimes mode": string
  "Diagnostic Running Time Components": string
  "System Logger_Text": string
  "Service report XML File Content:": string
  "System OnOff History": T13[]
types:
  T1 = cluster{"Parameter Name": string, "Value": string, "Comment": string}
  T2 = cluster{"Parameter Name": string, "Value": string, "Dimension": string, "Comment": string}
  T3 = cluster{"Parameter Name": string, "Combi": string, "Dry": string, "Wet": string, "Dimension": string, "Comment": string}
  T4 = cluster{"Parameter Name": string, "Status": string, "Dimension": string, "Comment": string}
  T5 = cluster{"Parameter Name": string, "First Time": string, "Last Time": string, "Quantity": string, "Comment": string}
  T6 = cluster{"Parameter Name": string, "Count": string, "Duration": string, "Dimension": string, "Comment": string}
  T7 = cluster{"Parameter Name": string, "Value": string, "Value relative": string, "Dimension": string, "Comment": string}
  T8 = cluster{"Parameter Name": string, "Actual": string, "Dimension": string, "Comment": string}
  T9 = cluster{"Parameter Name": string, "Actual": string, "Dimension": string, "Limit": string, "maximum": string, "Element 6": string, "Element 7": string}
  T10 = cluster{"Parameter Name": string, "Command": string, "Down_Switch": string, "Status": string, "Up_Switch": string, "Dimension": string, "Comment": string}
  T11 = cluster{"Parameter Name": string, "Update Date": string, "Version Name": string}
  T12 = cluster{"Replacement number": string, "BMK": string, "Component name": string, "Replace time": string, "Serial number": string, "Service note": string, "Type": string}
  T13 = cluster{"Parameter Name": string, "OnOffEvent": string, "Reason": string, "Time": string}
  T14 = cluster{"Parameter Name": string, "Combi": string, "Dry": string}
  T15 = cluster{"Parameter Name": string, "Status": string, "Dimension": string, "comment": string}
  T16 = cluster{"Boards": string, "Informations": string}
  T17 = cluster{"Parameter Name": string, "Actual": string, "Dimension": string, "Limit": string, "maximum": string, "Time_stamp": string, "Comment": string}
  T18 = cluster{"Parameter Name": string, "Actual": string, "Dimension": string, "comment": string}
  T19 = cluster{"Parameter Name": string, "Command": string, "Down_Switch": string, "Status": string, "Up_Switch": string, "dim": string, "Comment": string}
uses:
  NI::HTTP::GET.gvi
  Uppy::Function.gvi
  FileTasks::Read File Text.gvi
  NI::G Core::Error::Clear Error Cluster.gvi
  Library::Check_XML_Device.gviweb
  WebApp::Sort_Service_History_event.gviweb
  WebApp::Read_XML_Part.gviweb
  WebApp::Exlude_WA_Entrys.gviweb
  WebApp::Interpret_Common_Information.gviweb
  WebApp::Sort_Common_Infomation.gviweb
  WebApp::Interpret_Common_Information_iVario.gviweb
  WebApp::Interpret_Basic_Settings.gviweb
  WebApp::Sort_Basic_Settings.gviweb
  WebApp::Exclude_iVario_Entry.gviweb
  WebApp::Interpret_Basic_Settings_iVario.gviweb
  WebApp::Interpret_Diagnostic_RT_Data_Sensors.gviweb
  WebApp::Sort_Diagnostic_Real_Time_Data_Sensors.gviweb
  WebApp::Interpret_Diagnostic_RT_Data_Sensors_Heating.gviweb
  WebApp::Interpret_Diagnostic_RT_Data_Sensors_Movement.gviweb
  WebApp::Interpret_Diagnostic_RT_Data_Sensors_Pressure.gviweb
  WebApp::Interpret_Diagnostic_RT_Calibration.gviweb
  WebApp::Sort_Diagnostic_RT_Calibration.gviweb
  WebApp::Interpret_Diagnostic_Water_iCS_Switch.gviweb
  WebApp::Sort_Diagnostic_Water_iCs_Switch.gviweb
  WebApp::Diagnostic_Service_History.gviweb
  WebApp::Sort_Diagnostic_Service_History.gviweb
  WebApp::Interpret_Software_Version_History.gviweb
  WebApp::Interpret_System_OnOff_History.gviweb
  WebApp::Interpret_Component_Replacement_History.gviweb
  WebApp::Sort_Service_History_MSGs_Default.gviweb
  WebApp::Interpret_Diagnostic_RunningTimes_Comp.gviweb
  WebApp::Sort_RunningTimes_Components.gviweb
  WebApp::Interpret_SystemLogger.gviweb
  WebApp::Sort_System_Logger.gviweb
  WebApp::Interpret_Histogram_CPU_IO_Temperature.gviweb
  NI::G Core::Strings::Trim Whitespace.gvi
  NI::G Core::Strings::Search and Replace Pattern.gvi
  WebApp::Interpret_Diagnostic_RunningTimes_Modes.gviweb
  WebApp::Sort_Diagnostic_RunningTimes_Modes.gviweb
diagram:
  w1 = "Init"  # State
  # "": Auto Dose available
  # "": Unit-Type
  s1 = w1  # shift register
  s2 = ""  # shift register
  s3 = string[] []  # shift register
  s4 = ""  # shift register
  s5 = ""  # shift register
  s6 = ""  # shift register
  s7 = ""  # shift register
  s8 = 0  # shift register
  while {
    case (s1) {
      frame "Init", Default {
        $"Skala Histogram fan1 temp" <- "skala_fan_temp.jpg"
        $"skala Histogram pump pcb" <- "skala_120.jpg"
        w11 = "Read Ini File"  # State
        $"skala histogram IO" <- "skala_120.jpg"
        $"Skala Histogram fan2 temp" <- "skala_fan_temp.jpg"
        $"skala histogram CPU" <- "skala_120.jpg"
        $"Skala Histogram fan3 temp" <- "skala_fan_temp.jpg"
        $"skala Histogram LED hinge" <- "skala_120.jpg"
        $"Skala Histogram fan2 power" <- "skala_fan_Puis.jpg"
        $"Skala Histogram LED handle" <- "skala_120.jpg"
        $"Skala Histogram fan power" <- "skala_fan_Puis.jpg"
        $"Device:" <- "No_Picture.jpg"
        $"Skala Histogram Gas box" <- "skala_120.jpg"
        $"Skala Histogram fan3 power" <- "skala_fan_Puis.jpg"
        $"URL-Grafik" <- "Rational_Logo.png"
        $"Skala Histogram fan3 minVolt" <- "skala_fan_voltage.jpg"
        $"Skala Histogram fan1 minVolt" <- "skala_fan_voltage.jpg"
        $"skala Histogram fan 3 rpm" <- "skala_fan_RPM.jpg"
        $"Skala Histogram Basis MMI Load" <- "skala_MMI.jpg"
        $"skala Magnetron top" <- "skala_120.jpg"
        $"Skala Histogram fan1 max Volt" <- "skala_fan_voltage.jpg"
        $"skala Histogram fan 1 rpm" <- "skala_fan_RPM.jpg"
        $"skala Power Supply top" <- "skala_120.jpg"
        $"Skala Histogram Basis MMI CPU" <- "skala_MMI.jpg"
        $"Skala Histogram fan2 minVolt" <- "skala_fan_voltage.jpg"
        $"skala Histogram fan 2 rpm" <- "skala_fan_RPM.jpg"
        $"skala Magnetron bottom" <- "skala_120.jpg"
        $"Skala Histogram MMI CPU" <- "skala_MMI.jpg"
        $"Skala Histogram fan2 maxVolt" <- "skala_fan_voltage.jpg"
        $"skala histogram Power Supply bottom" <- "skala_120.jpg"
        $"Skala Histogram MMI Load" <- "skala_MMI.jpg"
        $"Skala Histogram fan3 maxVolt" <- "skala_fan_voltage.jpg"
        Property Node(instance in=reference to "Tabs with errors", "Visible"=FALSE, error in=no error) -> (error out=w12, instance out=w13)
        Close Reference(error in=w12, reference=w13) -> (error out=w14)
        Property Node(instance in=reference to "Previous page", "Visible"=FALSE, error in=w14) -> (error out=w15, instance out=w16)
        Property Node(instance in=reference to "Next page", "Visible"=TRUE, error in=w15) -> (error out=w17, instance out=w18)
        Close Reference(error in=w17, reference=w18) -> (error out=w19)
        Close Reference(error in=w19, reference=w16) -> (error out=w20)
        Property Node(instance in=reference to "Device", "Value"="iCombi Pro/iHexagon", error in=w20) -> (error out=w21, instance out=w22)
        Close Reference(error in=w21, reference=w22) -> (error out=w23)
        Property Node(instance in=reference to "String", "Visible"=FALSE, error in=w23) -> (error out=w24, instance out=w25)
        Close Reference(error in=w24, reference=w25) -> (error out=w26)
        Property Node(instance in=reference to "Page 1", "Visible"=TRUE, error in=w26) -> (error out=w27, instance out=w28)
        Property Node(instance in=reference to "Page 2", "Visible"=FALSE, error in=w27) -> (error out=w29, instance out=w30)
        Property Node(instance in=reference to "Page 3", "Visible"=FALSE, error in=w29) -> (error out=w31, instance out=w32)
        Property Node(instance in=reference to "Page 4", "Visible"=FALSE, error in=w31) -> (error out=w33, instance out=w34)
        Property Node(instance in=reference to "ivario", "Visible"=FALSE, error in=w33) -> (error out=w35, instance out=w36)
        Property Node(instance in=reference to "Page content", "Visible"=TRUE, error in=w35) -> (error out=w37, instance out=w38)
        Close Reference(error in=w37, reference=w28) -> (error out=w39)
        Close Reference(error in=w39, reference=w30) -> (error out=w40)
        Close Reference(error in=w40, reference=w32) -> (error out=w41)
        Close Reference(error in=w41, reference=w34) -> (error out=w42)
        Close Reference(error in=w42, reference=w36) -> (error out=w43)
        Close Reference(error in=w43, reference=w38) -> (error out=w2)
        w3 = w11
        w4 = s2
        w5 = s3
        w6 = s4
        w7 = s5
        w8 = s6
        w9 = s7
        w10 = s8
      }
      frame "Reset all" {
        case ($"wrong unit type") {
          frame True { }
          frame False {
            $"Device :" <- "No_Picture.jpg"
            $"Device:" <- "No_Picture.jpg"
            $common <- T1[] []
            $"common Information ivario" <- T1[] []
          }
        }
        $"Total Running Time :" <- T6[] []
        $"Software-Service-History_iCP" <- T14[] []
        $"Diagnostic Running Times Modes" <- T6[] []
        $"Software-Service-History_iVario" <- T14[] []
        $"Total Running Time:" <- T6[] []
        $"System Logger Output" <- T7[] []
        $Checkbox <- FALSE
        $"Diagnostic Running Times Components:" <- T6[] []
        $"Diagnostic RT Calibration" <- T3[] []
        w44 = "Wait For Interaction"  # State
        $"Histogram Basis RAM Load Percent" <- f64[] []
        $"Diagnostic Running Times Comp" <- T6[] []
        $"Histogram Basis CPU Load Percent" <- f64[] []
        $Diagnostic_RT_Data_Sensors_Pressure <- T15[] []
        $"Histogram MMI RAM Load Percent" <- f64[] []
        $"Diagnostic-Service-History" <- T5[] []
        $"Basic Informations" <- T2[] []
        $"Histogram MMI CPU Load Percent" <- f64[] []
        $"Boards_Information:" <- T16[] []
        $Diagnostic_Water_iCS_Switch <- T4[] []
        $Basic_Settings <- T2[] []
        $"Histogram fan 3 power profile W" <- f64[] []
        case ($Device) {
          frame "iCombi Pro/iHexagon", Default {
            for (N = 4) (iteration -> i1) {
              case (i1) {
                frame 0, Default {
                  Property Node(instance in=reference to "Page 1", "Value"=i1, "Visible"=TRUE, error in=no error) -> (error out=w46, instance out=w47)
                  Close Reference(error in=w46, reference=w47) -> (error out=w45)
                }
                frame 1 {
                  Property Node(instance in=reference to "Page 2", "Value"=i1, "Visible"=FALSE, error in=no error) -> (error out=w48, instance out=w49)
                  Close Reference(error in=w48, reference=w49) -> (error out=w45)
                }
                frame 2 {
                  Property Node(instance in=reference to "Page 3", "Value"=i1, "Visible"=FALSE, error in=no error) -> (error out=w50, instance out=w51)
                  Close Reference(error in=w50, reference=w51) -> (error out=w45)
                }
                frame 3 {
                  Property Node(instance in=reference to "Page 4", "Value"=i1, "Visible"=FALSE, error in=no error) -> (error out=w52, instance out=w53)
                  Close Reference(error in=w52, reference=w53) -> (error out=w45)
                }
              }
            }
          }
          frame "iVario" {
            Property Node(instance in=reference to "ivario", "Value"=0, error in=no error) -> (error out=w54, instance out=w55)
            Close Reference(error in=w54, reference=w55) -> (error out=w45)
          }
        }
        Property Node(instance in=reference to "Previous page", "Visible"=FALSE, error in=w45) -> (error out=w56, instance out=w57)
        Property Node(instance in=reference to "Next page", "Visible"=TRUE, error in=w56) -> (error out=w58, instance out=w59)
        Close Reference(error in=w58, reference=w59) -> (error out=w60)
        Close Reference(error in=w60, reference=w57) -> (error out=w2)
        $"Board Information:" <- T16[] []
        $Diagnostic_RT_Data_Sensors <- T17[] []
        $"Diagnostic-Service-History_iVario" <- T5[] []
        $Diagnostic_RT_Data_Sensors_Heating <- T18[] []
        $Diagnostic_RT_Data_Sensors_mouvement <- T19[] []
        $"Histogram fan 1 Voltage min_V_1phase_3phase" <- f64[] []
        $"Histogram fan 1 Voltage max_V_1phase_3phase" <- f64[] []
        $"Histogram fan 3 RPM profile 1 min" <- f64[] []
        $"Histogram fan 1 Temperature_profile Celsius" <- f64[] []
        $"Histogram fan 2 RPM profile 1 min" <- f64[] []
        $"Histogram fan 3 Voltage min_V_1phase_3phase" <- f64[] []
        $"Histogram fan 2 power profile W" <- f64[] []
        $"Histogram fan 1 power profile W" <- f64[] []
        $"Histogram fan 3 power profile W" <- f64[] []
        $"Histogram gas box Temperature profile Celsius" <- f64[] []
        $"Histogram fan 3 Temperature_profile Celsius" <- f64[] []
        $"Histogram fan 1 RPM profile 1 min" <- f64[] []
        $"Histogram fan 2 Temperature_profile Celsius" <- f64[] []
        $"Histogram pump pcb Temperature profile Celsius" <- f64[] []
        $"Histogram cpu pcb Temperature profile Celsius" <- f64[] []
        $"Histogram fan 2 Voltage max_V_1phase_3phase" <- f64[] []
        $"Histogram LED handle side Temperature profile Celsius" <- f64[] []
        $"Histogram IO Temperature profile Celsius" <- f64[] []
        $"Histogram LED hinge side Temperature profile Celsius" <- f64[] []
        w3 = w44
        w4 = s2
        w5 = s3
        w6 = s4
        w7 = s5
        w8 = s6
        w9 = s7
        w10 = s8
      }
      frame "Change Page" {
        w61 = "Wait For Interaction"  # State
        case ($"Page selector") {
          frame "Page 1", Default {
            Property Node(instance in=reference to "Page 2", "Visible"=FALSE, error in=no error) -> (error out=w69, instance out=w63)
            Property Node(instance in=reference to "Page 1", "Visible"=TRUE, error in=w69) -> (error out=w70, instance out=w64)
            Property Node(instance in=reference to "Page 3", "Visible"=FALSE, error in=w70) -> (error out=w71, instance out=w65)
            Property Node(instance in=reference to "Page 4", "Visible"=FALSE, error in=w71) -> (instance out=w66)
            Property Node(instance in=reference to "Previous page", "Visible"=FALSE) -> (error out=w72, instance out=w67)
            Property Node(instance in=reference to "Next page", "Visible"=TRUE, error in=w72) -> (error out=w62, instance out=w68)
          }
          frame "Page 2" {
            Property Node(instance in=reference to "Page 2", "Visible"=TRUE, error in=no error) -> (error out=w73, instance out=w63)
            Property Node(instance in=reference to "Page 1", "Visible"=FALSE, error in=w73) -> (error out=w74, instance out=w64)
            Property Node(instance in=reference to "Page 3", "Visible"=FALSE, error in=w74) -> (error out=w75, instance out=w65)
            Property Node(instance in=reference to "Page 4", "Visible"=FALSE, error in=w75) -> (error out=w76, instance out=w66)
            Property Node(instance in=reference to "Previous page", "Visible"=TRUE, error in=w76) -> (error out=w77, instance out=w67)
            Property Node(instance in=reference to "Next page", "Visible"=TRUE, error in=w77) -> (error out=w62, instance out=w68)
          }
          frame "Page 3" {
            Property Node(instance in=reference to "Page 2", "Visible"=FALSE, error in=no error) -> (error out=w78, instance out=w63)
            Property Node(instance in=reference to "Page 1", "Visible"=FALSE, error in=w78) -> (error out=w79, instance out=w64)
            Property Node(instance in=reference to "Page 3", "Visible"=TRUE, error in=w79) -> (error out=w80, instance out=w65)
            Property Node(instance in=reference to "Page 4", "Visible"=FALSE, error in=w80) -> (error out=w81, instance out=w66)
            Property Node(instance in=reference to "Previous page", "Visible"=TRUE, error in=w81) -> (error out=w82, instance out=w67)
            Property Node(instance in=reference to "Next page", "Visible"=TRUE, error in=w82) -> (error out=w62, instance out=w68)
          }
          frame "Page 4" {
            Property Node(instance in=reference to "Page 2", "Visible"=FALSE, error in=no error) -> (error out=w83, instance out=w63)
            Property Node(instance in=reference to "Page 1", "Visible"=FALSE, error in=w83) -> (error out=w84, instance out=w64)
            Property Node(instance in=reference to "Page 3", "Visible"=FALSE, error in=w84) -> (error out=w85, instance out=w65)
            Property Node(instance in=reference to "Page 4", "Visible"=TRUE, error in=w85) -> (error out=w86, instance out=w66)
            Property Node(instance in=reference to "Previous page", "Visible"=TRUE, error in=w86) -> (error out=w87, instance out=w67)
            Property Node(instance in=reference to "Next page", "Visible"=FALSE, error in=w87) -> (error out=w62, instance out=w68)
          }
        }
        Close Reference(error in=w62, reference=w63) -> (error out=w88)
        Close Reference(error in=w88, reference=w64) -> (error out=w89)
        Close Reference(error in=w89, reference=w65) -> (error out=w90)
        Close Reference(error in=w90, reference=w66) -> (error out=w91)
        Close Reference(error in=w91, reference=w67) -> (error out=w92)
        Close Reference(error in=w92, reference=w68) -> (error out=w2)
        w3 = w61
        w4 = s2
        w5 = s3
        w6 = s4
        w7 = s5
        w8 = s6
        w9 = s7
        w10 = s8
      }
      frame "Change Device" {
        w93 = "Wait For Interaction"  # State
        case ($Device) {
          frame "iCombi Pro/iHexagon", Default {
            Property Node(instance in=reference to "Page content", "Visible"=TRUE) -> (error out=w102, instance out=w101)
            Property Node(instance in=reference to "Page selector", "Visible"=TRUE, "Value"="Page 1", error in=w102) -> (error out=w103, instance out=w100)
            Property Node(instance in=reference to "ivario", "Visible"=FALSE, error in=w103) -> (error out=w104, instance out=w99)
            Property Node(instance in=reference to "Page 2", "Visible"=FALSE, error in=w104) -> (error out=w105, instance out=w95)
            Property Node(instance in=reference to "Page 1", "Visible"=TRUE, error in=w105) -> (error out=w106, instance out=w96)
            Property Node(instance in=reference to "Page 3", "Visible"=FALSE, error in=w106) -> (error out=w107, instance out=w97)
            Property Node(instance in=reference to "Page 4", "Visible"=FALSE, error in=w107) -> (error out=w94, instance out=w98)
          }
          frame "iVario" {
            Property Node(instance in=reference to "Page content", "Visible"=FALSE, error in=no error) -> (error out=w108, instance out=w101)
            Property Node(instance in=reference to "Page selector", "Visible"=FALSE, error in=w108) -> (error out=w109, instance out=w100)
            Property Node(instance in=reference to "ivario", "Visible"=TRUE, error in=w109) -> (error out=w110, instance out=w99)
            Property Node(instance in=reference to "Page 2", "Visible"=FALSE, error in=w110) -> (error out=w111, instance out=w95)
            Property Node(instance in=reference to "Page 1", "Visible"=FALSE, error in=w111) -> (error out=w112, instance out=w96)
            Property Node(instance in=reference to "Page 3", "Visible"=FALSE, error in=w112) -> (error out=w113, instance out=w97)
            Property Node(instance in=reference to "Page 4", "Visible"=FALSE, error in=w113) -> (error out=w94, instance out=w98)
          }
        }
        Close Reference(error in=w94, reference=w95) -> (error out=w114)
        Close Reference(error in=w114, reference=w96) -> (error out=w115)
        Close Reference(error in=w115, reference=w97) -> (error out=w116)
        Close Reference(error in=w116, reference=w98) -> (error out=w117)
        Close Reference(error in=w117, reference=w99) -> (error out=w118)
        Close Reference(error in=w118, reference=w100) -> (error out=w119)
        Close Reference(error in=w119, reference=w101) -> (error out=w2)
        w3 = w93
        w4 = s2
        w5 = s3
        w6 = s4
        w7 = s5
        w8 = s6
        w9 = s7
        w10 = s8
      }
      frame "Read Ini File" {
        w120 = "Wait For Interaction"  # State
        call "GET.gvi"(url="Config_XML_Datainterpreter.ini", error in=no error) -> (body=w121, error out=w122)
        call "Function.gvi"(string in=w121, Error Cluster Constant=w122) -> (Output=w5, Output_error=w2)
        w3 = w120
        w4 = s2
        w6 = s4
        w7 = s5
        w8 = s6
        w9 = s7
        w10 = s8
      }
      frame "Read XML File" {
        call "Read File Text.gvi"(allowed file types=[".xml"], error in=no error) -> (file content=w123, file name=w124, error out=w125)
        case (w125) {
          frame Error, Default {
            w126 = "Wait For Interaction"  # State
            call "Clear Error Cluster.gvi"(error in=w125) -> (error out=w2)
            w3 = w126
            w4 = ""
          }
          frame No Error {
            call "Clear Error Cluster.gvi"(error in=w125) -> (error out=w127)
            case ($Device) {
              frame "iVario" {
                call "Check_XML_Device.gviweb"(XML Name=w124, Error Input=w127, XML Content=w123, First Check="Pan", Second Check="Potentiometer", Sous-Fix="RAT") -> (Error Output=w128, XML fine ?=w129)
                case (w129) {
                  frame False, Default {
                    $"wrong unit type" <- FALSE
                    w130 = "Reset all"  # State
                    call "Check_XML_Device.gviweb"(XML Name=w124, Error Input=w128, XML Content=w123, First Check="Histogram", Second Check="CalibN1", Sous-Fix="RAG") -> (Error Output=w2, XML fine ?=w131)
                    case (w131) {
                      frame False, Default {
                        w132 = "The service report is invalid, please check the XML file you have opened"
                        One Button Dialog(message=w132)
                      }
                      frame True {
                        w133 = "Please select iCombi as device and reload the selected Service Report XML file !"
                        One Button Dialog(message=w133)
                      }
                    }
                    w3 = w130
                  }
                  frame True {
                    w134 = "Common Information iVario"  # State
                    w3 = w134
                    w2 = w128
                  }
                }
              }
              frame "iCombi Pro/iHexagon", Default {
                call "Check_XML_Device.gviweb"(XML Name=w124, Error Input=w127, XML Content=w123, First Check="Histogram", Second Check="CalibN1", Sous-Fix="RAG") -> (Error Output=w135, XML fine ?=w136)
                case (w136) {
                  frame False, Default {
                    $"wrong unit type" <- FALSE
                    w137 = "Reset all"  # State
                    call "Check_XML_Device.gviweb"(XML Name=w124, Error Input=w135, XML Content=w123, First Check="Pan", Second Check="Potentiometer", Sous-Fix="RAT") -> (Error Output=w2, XML fine ?=w138)
                    case (w138) {
                      frame False, Default {
                        w139 = "The service report is invalid, please check the XML file you have opened"
                        One Button Dialog(message=w139)
                      }
                      frame True {
                        w140 = "Please select iVario as device and reload the selected Service Report XML file !"
                        One Button Dialog(message=w140)
                      }
                    }
                    w3 = w137
                  }
                  frame True {
                    w141 = "Common Information"  # State
                    w3 = w141
                    w2 = w135
                  }
                }
              }
            }
            $"Service report XML File Content:" <- w123
            w4 = w123
          }
        }
        w5 = s3
        w6 = s4
        w7 = s5
        w8 = s6
        w9 = s7
        w10 = s8
      }
      frame "Wait For Interaction" {
        event {
          on "Analyse" Value changed {
            w142 = "Read XML File"  # State
            w2 = no error
            w3 = w142
            w10 = default
          }
          on "Error_Selektor" Value changed {
            w143 = "Common Information"  # State
            w2 = no error
            w3 = w143
            w10 = default
          }
          on "Page selector" Value changed {
            w144 = "Change Page"  # State
            w2 = no error
            w3 = w144
            w10 = default
          }
          on "Device" Value changed {
            w145 = "Change Device"  # State
            w2 = no error
            w3 = w145
            w10 = default
          }
          on "Info_Plot" Value changed {
            w146 = "Wait For Interaction"  # State
            Event Data() -> ("New Value"=w147)
            case (w147) {
              frame False, Default {
                Property Node(instance in=reference to "String", "Visible"=FALSE, error in=no error) -> (error out=w148, instance out=w149)
              }
              frame True {
                Property Node(instance in=reference to "String", "Visible"=TRUE, error in=no error) -> (error out=w148, instance out=w149)
                w150 = "Press the drop down menu under \"Plot\" \nand change the graph settings as desired."
                $String <- w150
              }
            }
            Close Reference(error in=w148, reference=w149) -> (error out=w2)
            w3 = w146
            w10 = default
          }
          on "Page content" Value changed {
            w151 = "Wait For Interaction"  # State
            w152 = """Page contents:

Page 1: 
- Common Information.
- Basic Settings.
- Diagnostic Real Time Data Sensors.
- Diagnostic RT Calibration.
- Diagnostic Water iCS Switch.
- Diagnostic Service History.
- Diagnostic RunningTimes Components.
- Software Version History.

Page 2: 
- Histogram temperature CPU & IO.
- Diagnostic RunningTimes Modes.
- System Logger, Histogram temperature LEDs.
- Histogram temperature pump pcb & Gas box.
- Histogram temperature pump pcb & Histogram Fan 1 RPM & Power.
- Component Replacement History.

Page 3: 
- Histogram Fan1 Temp.&Voltages.
- Histogram Fan 2 RPM & Power.
- Histogram Fan2 Temp.&Voltages.
- Histogram Fan 3 RPM & Power.
- Histogram Fan3 Temp.&Voltages.
- Histogram MMI.
- System OnOff History.
     
Page 4: 
- Histogram Basis CPU & RAM Load, 
- Histogram Magnetron Temperature (iHexagon) & Power.
- Histogram Power Supply Temperature (iHexagon).
- Service report XML File Content."""
            One Button Dialog(message=w152)
            w2 = default
            w3 = w151
            w10 = default
          }
          on "Sort table ivario" Value changed {
            w153 = "Wait For Interaction"  # State
            Event Data() -> ("Old Value"=w154)
            Not(x=w154) -> w155
            call "Sort_Service_History_event.gviweb"(Diagnostic Service History input=$"Diagnostic-Service-History_iVario", Event=w155, Error Cluster input=no error) -> (Diagnostic Service History output=w156, Error Output=w2)
            $"Diagnostic-Service-History_iVario" <- w156
            w3 = w153
            w10 = default
          }
          on "Sort table iCombi" Value changed {
            w157 = "Wait For Interaction"  # State
            Event Data() -> ("Old Value"=w158)
            Not(x=w158) -> w159
            call "Sort_Service_History_event.gviweb"(Diagnostic Service History input=$"Diagnostic-Service-History", Event=w159, Error Cluster input=no error) -> (Diagnostic Service History output=w160, Error Output=w2)
            $"Diagnostic-Service-History" <- w160
            w3 = w157
            w10 = default
          }
          on "Next page" Value changed {
            Event Data() -> ("New Value"=w161)
            case (w161) {
              frame False, Default {
                w10 = s8
                w2 = no error
              }
              frame True {
                Increment(x=s8) -> w162
                Is Less Or Equal(x=w162, y=3) -> w163
                case (w163) {
                  frame False, Default {
                    w10 = 3
                    w2 = no error
                  }
                  frame True {
                    Property Node(instance in=reference to "Page selector", "Value"=w162, error in=no error) -> (error out=w2)
                    w10 = w162
                  }
                }
              }
            }
            w3 = "Change Page"
          }
          on "Previous page" Value changed {
            Event Data() -> ("New Value"=w164)
            case (w164) {
              frame False, Default {
                w10 = s8
                w2 = no error
              }
              frame True {
                Decrement(x=s8) -> w165
                Is Less Or Equal(x=w165, y=3) -> w166
                case (w166) {
                  frame False, Default {
                    w10 = 3
                    w2 = no error
                  }
                  frame True {
                    Property Node(instance in=reference to "Page selector", "Value"=w165, error in=no error) -> (error out=w2)
                    w10 = w165
                  }
                }
              }
            }
            w3 = "Change Page"
          }
        }
        $"add BMK to common information" <- FALSE
        w4 = s2
        w5 = s3
        w6 = s4
        w7 = s5
        w8 = s6
        w9 = s7
      }
      frame "Common Information" {
        call "Read_XML_Part.gviweb"(Input XML=s2, Start XML Part="<Common_Information>", End XML Part="</Common_Information>", Error in=no error) -> (Output XML array=w167, Error out=w168)
        call "Exlude_WA_Entrys.gviweb"(Input XML array=w167, Error in=w168) -> (Without_WA_Entrys=w169, Output Error=w170)
        call "Interpret_Common_Information.gviweb"(Common Information Entrys=w169, Language Entrys=s3, BMKs=$"Changed Component", Error Cluster Constant=w170) -> (Startup Date and Time=w8, Device:=w171, common=w172, Boards Informations:=w173, Output Error=w174, Auto Dose=w9, Unit-type=w6)
        case (w171) {
          frame "No_Analyse.png" {
            $"wrong unit type" <- TRUE
            w175 = "Reset all"  # State
            $"Page selector" <- "Page 1"
            $"Page 1" <- 0
            w3 = w175
          }
          frame "False", Default {
            case ($"add BMK to common information") {
              frame True {
                w176 = "Update Tab View"  # State
                w3 = w176
              }
              frame False {
                w177 = "Basic Settings"  # State
                w3 = w177
              }
            }
          }
        }
        $"Device:" <- w171
        $"Board Information:" <- w173
        call "Sort_Common_Infomation.gviweb"(Error_Selektor=$Error_Selektor, Common Information=w172, Input Error=w174) -> (Output=w178, Common Information_Error=w179, Output Error=w2)
        $common <- w178
        $"Common Information_Error" <- w179
        w4 = s2
        w5 = s3
        w7 = s5
        w10 = s8
      }
      frame "Common Information iVario" {
        call "Read_XML_Part.gviweb"(Input XML=s2, Start XML Part="<Common_Information>", End XML Part="</Common_Information>", Error in=no error) -> (Output XML array=w180, Error out=w181)
        call "Exlude_WA_Entrys.gviweb"(Input XML array=w180, Error in=w181) -> (Without_WA_Entrys=w182, Output Error=w183)
        call "Interpret_Common_Information_iVario.gviweb"(Common Information Entrys=w182, Language Entrys=s3, Error Cluster Constant=w183) -> (Device:=w184, common=w185, Boards Informations:=w186, Output Error=w2, Unit-type=w6)
        case (w184) {
          frame "False", Default {
            w187 = "Basic Settings iVario"  # State
            w3 = w187
          }
          frame "No_Analyse.png" {
            $"wrong unit type" <- TRUE
            w188 = "Reset all"  # State
            w3 = w188
          }
        }
        $"Device :" <- w184
        $"common Information ivario" <- w185
        $"Boards_Information:" <- w186
        w4 = s2
        w5 = s3
        w7 = s5
        w8 = s6
        w9 = s7
        w10 = s8
      }
      frame "Basic Settings" {
        w189 = "Diagnostic RT Data Sensors"  # State
        call "Read_XML_Part.gviweb"(Input XML=s2, Start XML Part="<Basic_Settings>", End XML Part="</Basic_Settings>", Error in=no error) -> (Output XML array=w190, Error out=w191)
        call "Exlude_WA_Entrys.gviweb"(Input XML array=w190, Error in=w191) -> (Without_WA_Entrys=w192, Output Error=w193)
        call "Interpret_Basic_Settings.gviweb"(Basic Settings Entrys=w192, Config File infos=s3, Device Type=s4, Error input=w193) -> (Basic Informations=w194, Output Error=w195)
        call "Sort_Basic_Settings.gviweb"(Error_Selektor=$Error_Selektor, Basic Settings=w194, Input Error=w195) -> (Output Basic Settings=w196, Basic_Settings_Error=w197, Output Error=w2)
        $Basic_Settings <- w196
        $"add BMK to common information" <- FALSE
        $Basic_Settings_Error <- w197
        w3 = w189
        w4 = s2
        w5 = s3
        w6 = s4
        w7 = s5
        w8 = s6
        w9 = s7
        w10 = s8
      }
      frame "Basic Settings iVario" {
        w198 = "Diagnostic RT Data Sensors Heating iVario"  # State
        call "Read_XML_Part.gviweb"(Input XML=s2, Start XML Part="<Basic_Settings>", End XML Part="</Basic_Settings>", Error in=no error) -> (Output XML array=w199, Error out=w200)
        call "Exlude_WA_Entrys.gviweb"(Input XML array=w199, Error in=w200) -> (Without_WA_Entrys=w201, Output Error=w202)
        call "Exclude_iVario_Entry.gviweb"(Input XML array=w201, Excluded_Entry="Power_State_WA82", Error in=w202) -> (Without_WA_Entrys=w203, Output Error=w204)
        call "Interpret_Basic_Settings_iVario.gviweb"(Basic Settings Entrys=w203, Device Type=s4, Error input=w204) -> (Basic Informations=w205, Output Error=w2)
        $"Basic Informations" <- w205
        w3 = w198
        w4 = s2
        w5 = s3
        w6 = s4
        w7 = s5
        w8 = s6
        w9 = s7
        w10 = s8
      }
      frame "Diagnostic RT Data Sensors" {
        w206 = "DIagnostic RT Calibration"  # State
        call "Read_XML_Part.gviweb"(Input XML=s2, Start XML Part="<Diagnostic_RT_Data_Sensors>", End XML Part="</Diagnostic_RT_Data_Sensors>", Error in=no error) -> (Output XML array=w207, Error out=w208)
        call "Exlude_WA_Entrys.gviweb"(Input XML array=w207, Error in=w208) -> (Without_WA_Entrys=w209, Output Error=w210)
        # s7: Auto Dose Available
        call "Interpret_Diagnostic_RT_Data_Sensors.gviweb"(Diagnostic Settings Entrys=w209, Config File infos=s3, Device Type=s4, Error input=w210, Auto Dose=s7) -> (Diagnostic_RT_Data_Sensors=w211, Output Error=w212)
        call "Sort_Diagnostic_Real_Time_Data_Sensors.gviweb"(Error_Selektor=$Error_Selektor, Diagnostic_RT_Data_Sensors=w211, Input Error=w212) -> (Output=w213, Diagnostic Real Time Data Sensors=w214, Output Error=w2)
        $Diagnostic_RT_Data_Sensors <- w213
        $"Diagnostic Real Time Data Sensors" <- w214
        w3 = w206
        w4 = s2
        w5 = s3
        w6 = s4
        w7 = s5
        w8 = s6
        w9 = s7
        w10 = s8
      }
      frame "Diagnostic RT Data Sensors Heating iVario" {
        w215 = "Diagnostic RT Data Sensors Movement iVario"  # State
        call "Read_XML_Part.gviweb"(Input XML=s2, Start XML Part="<Diagnostic_RT_Data_Sensors_Heating>", End XML Part="</Diagnostic_RT_Data_Sensors_Heating>", Error in=no error) -> (Output XML array=w216, Error out=w217)
        Array Size(array=w216) -> (size(s)=w218)
        Is Greater Than 0(x=w218) -> w219
        case (w219) {
          frame False, Default {
            call "Read_XML_Part.gviweb"(Input XML=s2, Start XML Part="<Diagnostic_RT_Data_Sensors_(Heating)>", End XML Part="</Diagnostic_RT_Data_Sensors_(Heating)>", Error in=w217) -> (Output XML array=w221, Error out=w220)
          }
          frame True {
            w220 = w217
            w221 = w216
          }
        }
        call "Exlude_WA_Entrys.gviweb"(Input XML array=w221, Error in=w220) -> (Without_WA_Entrys=w222, Output Error=w223)
        call "Interpret_Diagnostic_RT_Data_Sensors_Heating.gviweb"(Diagnostic Settings Entrys=w222, Device Type=s4, Error input=w223) -> (Output=w224, Output Error=w2)
        $Diagnostic_RT_Data_Sensors_Heating <- w224
        w3 = w215
        w4 = s2
        w5 = s3
        w6 = s4
        w7 = s5
        w8 = s6
        w9 = s7
        w10 = s8
      }
      frame "Diagnostic RT Data Sensors Movement iVario" {
        w225 = "Diagnostic RT Data Sensors Pressure"  # State
        call "Read_XML_Part.gviweb"(Input XML=s2, Start XML Part="<Diagnostic_RT_Data_Sensors_Movement>", End XML Part="</Diagnostic_RT_Data_Sensors_Movement>", Error in=no error) -> (Output XML array=w226, Error out=w227)
        Array Size(array=w226) -> (size(s)=w228)
        Is Greater Than 0(x=w228) -> w229
        case (w229) {
          frame False, Default {
            call "Read_XML_Part.gviweb"(Input XML=s2, Start XML Part="<Diagnostic_RT_Data_Sensors_(Movement)>", End XML Part="</Diagnostic_RT_Data_Sensors_(Movement)>", Error in=w227) -> (Output XML array=w231, Error out=w230)
          }
          frame True {
            w230 = w227
            w231 = w226
          }
        }
        call "Exlude_WA_Entrys.gviweb"(Input XML array=w231, Error in=w230) -> (Without_WA_Entrys=w232, Output Error=w233)
        call "Interpret_Diagnostic_RT_Data_Sensors_Movement.gviweb"(Diagnostic Settings mouvement Entrys=w232, Device Type=s4, Error input=w233) -> (Output mouvement=w234, Output Error=w2)
        $Diagnostic_RT_Data_Sensors_mouvement <- w234
        w3 = w225
        w4 = s2
        w5 = s3
        w6 = s4
        w7 = s5
        w8 = s6
        w9 = s7
        w10 = s8
      }
      frame "Diagnostic RT Data Sensors Pressure" {
        w235 = "Diagnostic Service History iVario"  # State
        call "Read_XML_Part.gviweb"(Input XML=s2, Start XML Part="<Diagnostic_RT_Data_Sensors_Pressure>", End XML Part="</Diagnostic_RT_Data_Sensors_Pressure>", Error in=no error) -> (Output XML array=w236, Error out=w237)
        Array Size(array=w236) -> (size(s)=w238)
        Is Greater Than 0(x=w238) -> w239
        case (w239) {
          frame False, Default {
            call "Read_XML_Part.gviweb"(Input XML=s2, Start XML Part="<Diagnostic_RT_Data_Sensors_(Pressure)>", End XML Part="</Diagnostic_RT_Data_Sensors_(Pressure)>", Error in=w237) -> (Output XML array=w241, Error out=w240)
          }
          frame True {
            w240 = w237
            w241 = w236
          }
        }
        call "Exlude_WA_Entrys.gviweb"(Input XML array=w241, Error in=w240) -> (Without_WA_Entrys=w242, Output Error=w243)
        call "Interpret_Diagnostic_RT_Data_Sensors_Pressure.gviweb"(Pressure Entrys=w242, Device Type=s4, Error input=w243) -> (Output Pressure=w244, Output Error=w2)
        $Diagnostic_RT_Data_Sensors_Pressure <- w244
        w3 = w235
        w4 = s2
        w5 = s3
        w6 = s4
        w7 = s5
        w8 = s6
        w9 = s7
        w10 = s8
      }
      frame "DIagnostic RT Calibration" {
        w245 = "Diagnostic Water iCS Switch"  # State
        call "Read_XML_Part.gviweb"(Input XML=s2, Start XML Part="<Diagnostic_RT_Calibration>", End XML Part="</Diagnostic_RT_Calibration>", Error in=no error) -> (Output XML array=w246, Error out=w247)
        call "Exlude_WA_Entrys.gviweb"(Input XML array=w246, Error in=w247) -> (Without_WA_Entrys=w248, Output Error=w249)
        call "Interpret_Diagnostic_RT_Calibration.gviweb"(Diagnostic RT Calibration Entrys=w248, Error Cluster Constant=w249) -> (Diagnostic RT Calibration=w250, Calibrated=w251, Output Error=w252)
        $Checkbox <- w251
        call "Sort_Diagnostic_RT_Calibration.gviweb"(Error_Selektor=$Error_Selektor, Diagnostic RT Calibration=w250, Input Error=w252) -> (Output=w253, Diagnostic Real Time Data Sensors=w254, Output Error=w2)
        $"Diagnostic RT Calibration" <- w253
        $"Diagnostic RT Calibration_Text" <- w254
        w3 = w245
        w4 = s2
        w5 = s3
        w6 = s4
        w7 = s5
        w8 = s6
        w9 = s7
        w10 = s8
      }
      frame "Diagnostic Water iCS Switch" {
        w255 = "Diagnostic Service History"  # State
        call "Read_XML_Part.gviweb"(Input XML=s2, Start XML Part="<Diagnostic_Water_iCS_Switch>", End XML Part="</Diagnostic_Water_iCS_Switch>", Error in=no error) -> (Output XML array=w256, Error out=w257)
        call "Exlude_WA_Entrys.gviweb"(Input XML array=w256, Error in=w257) -> (Without_WA_Entrys=w258, Output Error=w259)
        call "Interpret_Diagnostic_Water_iCS_Switch.gviweb"(Diagnostic Water iCS Switch Entrys=w258, Device Type=s4, Error Cluster input=w259, Auto Dose=s7) -> (Diagnostic Water iCS Switch Output=w260, Output_Error=w261)
        call "Sort_Diagnostic_Water_iCs_Switch.gviweb"(Error_Selektor=$Error_Selektor, Diagnostic Water iCS Switch Output=w260, Input Error=w261) -> (Output=w262, Diagnostic Water iCS Switch=w263, Output Error=w2)
        $Diagnostic_Water_iCS_Switch <- w262
        $"Diagnostic Water iCS Switch Text" <- w263
        w3 = w255
        w4 = s2
        w5 = s3
        w6 = s4
        w7 = s5
        w8 = s6
        w9 = s7
        w10 = s8
      }
      frame "Diagnostic Service History" {
        w264 = "Diagnostic Running Times Modes"  # State
        call "Read_XML_Part.gviweb"(Input XML=s2, Start XML Part="<Diagnostic-Service-History>", End XML Part="</Diagnostic-Service-History>", Error in=no error) -> (Output XML array=w265, Error out=w266)
        call "Exlude_WA_Entrys.gviweb"(Input XML array=w265, Error in=w266) -> (Without_WA_Entrys=w267, Output Error=w268)
        call "Diagnostic_Service_History.gviweb"(Diagnostic Service History Entrys=w267, Device Type=s2, Error Cluster input=w268) -> (Diagnostic Service History Output=w269, Error Output=w270)
        call "Sort_Diagnostic_Service_History.gviweb"(Error_Selektor=$Error_Selektor, Diagnostic Service History Output=w269, Input Error=w270) -> (Output=w271, Diagnostic Service History Text=w272, Output Error=w2)
        $"Diagnostic-Service-History" <- w271
        $"Diagnostic Service History Text" <- w272
        w3 = w264
        w4 = s2
        w5 = s3
        w6 = s4
        w7 = s5
        w8 = s6
        w9 = s7
        w10 = s8
      }
      frame "Software Version History" {
        w273 = "Component Replacement History iCombi"  # State
        call "Read_XML_Part.gviweb"(Input XML=s2, Start XML Part="<Software-Version-History>", End XML Part="</Software-Version-History>", Error in=no error) -> (Output XML array=w274, Error out=w275)
        call "Exlude_WA_Entrys.gviweb"(Input XML array=w274, Error in=w275) -> (Without_WA_Entrys=w276, Output Error=w277)
        call "Interpret_Software_Version_History.gviweb"(Diagnostic Service History Entrys=w276, Error Cluster input=w277) -> (Software Version History=w278, Error Output=w2)
        $"Software-Service-History_iCP" <- w278
        w3 = w273
        w4 = s2
        w5 = s3
        w6 = s4
        w7 = s5
        w8 = s6
        w9 = s7
        w10 = s8
      }
      frame "System OnOff History" {
        w279 = "Common Information"  # State
        call "Read_XML_Part.gviweb"(Input XML=s2, Start XML Part="<System-OnOff-History>", End XML Part="</System-OnOff-History>", Error in=no error) -> (Output XML array=w280, Error out=w281)
        call "Exlude_WA_Entrys.gviweb"(Input XML array=w280, Error in=w281) -> (Without_WA_Entrys=w282, Output Error=w283)
        call "Interpret_System_OnOff_History.gviweb"(System OnOff History Entrys=w282, Error Cluster input=w283) -> (System OnOff History output=w284, Error Output=w2)
        $"System OnOff History" <- w284
        w3 = w279
        w4 = s2
        w5 = s3
        w6 = s4
        w7 = s5
        w8 = s6
        w9 = s7
        w10 = s8
      }
      frame "Component Replacement History iCombi" {
        w285 = "System OnOff History"  # State
        $"add BMK to common information" <- TRUE
        call "Read_XML_Part.gviweb"(Input XML=s2, Start XML Part="<Component-Replacement-History>", End XML Part="</Component-Replacement-History>", Error in=no error) -> (Output XML array=w286, Error out=w287)
        call "Exlude_WA_Entrys.gviweb"(Input XML array=w286, Error in=w287) -> (Without_WA_Entrys=w288, Output Error=w289)
        call "Interpret_Component_Replacement_History.gviweb"(Component Replacement History Entrys=w288, Error Cluster input=w289) -> (Component Replacement History=w290, Changed Component=w291, Error Output=w2)
        $"Component Replacement History" <- w290
        $"Changed Component" <- w291
        w3 = w285
        w4 = s2
        w5 = s3
        w6 = s4
        w7 = s5
        w8 = s6
        w9 = s7
        w10 = s8
      }
      frame "Software Version History iVario" {
        w292 = "Wait For Interaction"  # State
        call "Read_XML_Part.gviweb"(Input XML=s2, Start XML Part="<Software-Version-History>", End XML Part="</Software-Version-History>", Error in=no error) -> (Output XML array=w293, Error out=w294)
        call "Exlude_WA_Entrys.gviweb"(Input XML array=w293, Error in=w294) -> (Without_WA_Entrys=w295, Output Error=w296)
        call "Interpret_Software_Version_History.gviweb"(Diagnostic Service History Entrys=w295, Error Cluster input=w296) -> (Software Version History=w297, Error Output=w2)
        $"Software-Service-History_iVario" <- w297
        w3 = w292
        w4 = s2
        w5 = s3
        w6 = s4
        w7 = s5
        w8 = s6
        w9 = s7
        w10 = s8
      }
      frame "Diagnostic Service History iVario" {
        w298 = "Diagnostic Running Times Modes iVario "  # State
        call "Read_XML_Part.gviweb"(Input XML=s2, Start XML Part="<Diagnostic-Service-History>", End XML Part="</Diagnostic-Service-History>", Error in=no error) -> (Output XML array=w299, Error out=w300)
        call "Exlude_WA_Entrys.gviweb"(Input XML array=w299, Error in=w300) -> (Without_WA_Entrys=w301, Output Error=w302)
        call "Diagnostic_Service_History.gviweb"(Diagnostic Service History Entrys=w301, Device Type=s4, Error Cluster input=w302) -> (Diagnostic Service History Output=w303, Error Output=w304)
        call "Sort_Service_History_MSGs_Default.gviweb"(Diagnostic Service History input=w303, Error Cluster input=w304) -> (Diagnostic Service History output=w305, Error Output=w2)
        $"Diagnostic-Service-History_iVario" <- w305
        w3 = w298
        w4 = s2
        w5 = s3
        w6 = s4
        w7 = s5
        w8 = s6
        w9 = s7
        w10 = s8
      }
      frame "Diagnostic Running Times Comp" {
        w306 = "System Logger"  # State
        call "Read_XML_Part.gviweb"(Input XML=s2, Start XML Part="<Diagnostic-RunningTimes-Comp>", End XML Part="</Diagnostic-RunningTimes-Comp>", Error in=no error) -> (Output XML array=w307, Error out=w308)
        call "Exlude_WA_Entrys.gviweb"(Input XML array=w307, Error in=w308) -> (Without_WA_Entrys=w309, Output Error=w310)
        call "Interpret_Diagnostic_RunningTimes_Comp.gviweb"(Diagnostic Service History Entrys=w309, Total running time=s5, Error Cluster input=w310) -> (Running Time Component Output=w311, Error Cluster output=w312)
        call "Sort_RunningTimes_Components.gviweb"(Error_Selektor=$Error_Selektor, Running Time Component Output=w311, Input Error=w312) -> (Output=w313, Diagnostic Running Time Components=w314, Output Error=w2)
        $"Diagnostic Running Times Comp" <- w313
        $"Diagnostic Running Time Components" <- w314
        w3 = w306
        w4 = s2
        w5 = s3
        w6 = s4
        w7 = s5
        w8 = s6
        w9 = s7
        w10 = s8
      }
      frame "Diagnostic Running Times Component iVario " {
        w315 = "Software Version History iVario"  # State
        call "Read_XML_Part.gviweb"(Input XML=s2, Start XML Part="<Diagnostic-RunningTimes-Comp>", End XML Part="</Diagnostic-RunningTimes-Comp>", Error in=no error) -> (Output XML array=w316, Error out=w317)
        call "Exlude_WA_Entrys.gviweb"(Input XML array=w316, Error in=w317) -> (Without_WA_Entrys=w318, Output Error=w319)
        call "Interpret_Diagnostic_RunningTimes_Comp.gviweb"(Diagnostic Service History Entrys=w318, Total running time=s5, Error Cluster input=w319) -> (Running Time Component Output=w320, Error Cluster output=w2)
        $"Diagnostic Running Times Components:" <- w320
        w3 = w315
        w4 = s2
        w5 = s3
        w6 = s4
        w7 = s5
        w8 = s6
        w9 = s7
        w10 = s8
      }
      frame "System Logger" {
        w321 = "Histogram temperature CPU"  # State
        call "Read_XML_Part.gviweb"(Input XML=s2, Start XML Part="<SystemLogger>", End XML Part="</SystemLogger>", Error in=no error) -> (Output XML array=w322, Error out=w323)
        call "Exlude_WA_Entrys.gviweb"(Input XML array=w322, Error in=w323) -> (Without_WA_Entrys=w324, Output Error=w325)
        call "Interpret_SystemLogger.gviweb"(SystemLogger Entrys=w324, Startup Date and Time=s6, Error Cluster input=w325) -> (System Logger output=w326, Error Cluster output=w327)
        call "Sort_System_Logger.gviweb"(Error_Selektor=$Error_Selektor, System Logger=w326, Input Error=w327) -> (Output=w328, System Logger_2=w329, Output Error=w2)
        $"System Logger Output" <- w328
        $"System Logger_Text" <- w329
        w3 = w321
        w4 = s2
        w5 = s3
        w6 = s4
        w7 = s5
        w8 = s6
        w9 = s7
        w10 = s8
      }
      frame "Histogram temperature CPU" {
        w330 = "Histogram temperature IO"  # State
        call "Read_XML_Part.gviweb"(Input XML=s2, Start XML Part="<Histogram_cpu_pcb_-_Temperature_profile_Celsius>", End XML Part="</Histogram_cpu_pcb_-_Temperature_profile_Celsius>", Error in=no error) -> (Output XML array=w331, Error out=w332)
        call "Exlude_WA_Entrys.gviweb"(Input XML array=w331, Error in=w332) -> (Without_WA_Entrys=w333, Output Error=w334)
        call "Interpret_Histogram_CPU_IO_Temperature.gviweb"(Histogramm Entrys=w333, Error Cluster input=w334) -> (Signal=w335, Error Output=w2)
        $"Histogram cpu pcb Temperature profile Celsius" <- w335
        w3 = w330
        w4 = s2
        w5 = s3
        w6 = s4
        w7 = s5
        w8 = s6
        w9 = s7
        w10 = s8
      }
      frame "Histogram temperature IO" {
        w336 = "Histogram temperature LED hinge"  # State
        call "Read_XML_Part.gviweb"(Input XML=s2, Start XML Part="<Histogram_IO_pcb_-_Temperature_profile_Celsius>", End XML Part="</Histogram_IO_pcb_-_Temperature_profile_Celsius>", Error in=no error) -> (Output XML array=w337, Error out=w338)
        call "Exlude_WA_Entrys.gviweb"(Input XML array=w337, Error in=w338) -> (Without_WA_Entrys=w339, Output Error=w340)
        call "Interpret_Histogram_CPU_IO_Temperature.gviweb"(Histogramm Entrys=w339, Error Cluster input=w340) -> (Signal=w341, Error Output=w2)
        Array Subset(array=w341, index0=16, length0=2) -> w342
        $"Measured_temperature IO °C [Min/Max]:" <- w342
        Array Subset(array=w341, length0=16) -> w343
        $"Histogram IO Temperature profile Celsius" <- w343
        w3 = w336
        w4 = s2
        w5 = s3
        w6 = s4
        w7 = s5
        w8 = s6
        w9 = s7
        w10 = s8
      }
      frame "Histogram temperature LED hinge" {
        w344 = "Histogram temperature LED handle"  # State
        call "Read_XML_Part.gviweb"(Input XML=s2, Start XML Part="<Histogram_LED_hinge_side_-_Temperature_profile_Celsius>", End XML Part="</Histogram_LED_hinge_side_-_Temperature_profile_Celsius>", Error in=no error) -> (Output XML array=w345, Error out=w346)
        call "Exlude_WA_Entrys.gviweb"(Input XML array=w345, Error in=w346) -> (Without_WA_Entrys=w347, Output Error=w348)
        call "Interpret_Histogram_CPU_IO_Temperature.gviweb"(Histogramm Entrys=w347, Error Cluster input=w348) -> (Signal=w349, Error Output=w2)
        $"Histogram LED hinge side Temperature profile Celsius" <- w349
        w3 = w344
        w4 = s2
        w5 = s3
        w6 = s4
        w7 = s5
        w8 = s6
        w9 = s7
        w10 = s8
      }
      frame "Histogram temperature LED handle" {
        w350 = "Histogram temperature pump pcb"  # State
        call "Read_XML_Part.gviweb"(Input XML=s2, Start XML Part="<Histogram_LED_handle_side_-_Temperature_profile_Celsius>", End XML Part="</Histogram_LED_handle_side_-_Temperature_profile_Celsius>", Error in=no error) -> (Output XML array=w351, Error out=w352)
        call "Exlude_WA_Entrys.gviweb"(Input XML array=w351, Error in=w352) -> (Without_WA_Entrys=w353, Output Error=w354)
        call "Interpret_Histogram_CPU_IO_Temperature.gviweb"(Histogramm Entrys=w353, Error Cluster input=w354) -> (Signal=w355, Error Output=w2)
        $"Histogram LED handle side Temperature profile Celsius" <- w355
        w3 = w350
        w4 = s2
        w5 = s3
        w6 = s4
        w7 = s5
        w8 = s6
        w9 = s7
        w10 = s8
      }
      frame "Histogram temperature pump pcb" {
        w356 = "Histogram temperature Gas Box"  # State
        call "Read_XML_Part.gviweb"(Input XML=s2, Start XML Part="<Histogram_pump_pcb_-_Temperature_profile_Celsius>", End XML Part="</Histogram_pump_pcb_-_Temperature_profile_Celsius>", Error in=no error) -> (Output XML array=w357, Error out=w358)
        call "Exlude_WA_Entrys.gviweb"(Input XML array=w357, Error in=w358) -> (Without_WA_Entrys=w359, Output Error=w360)
        call "Interpret_Histogram_CPU_IO_Temperature.gviweb"(Histogramm Entrys=w359, Error Cluster input=w360) -> (Signal=w361, Error Output=w2)
        $"Histogram pump pcb Temperature profile Celsius" <- w361
        w3 = w356
        w4 = s2
        w5 = s3
        w6 = s4
        w7 = s5
        w8 = s6
        w9 = s7
        w10 = s8
      }
      frame "Histogram temperature Gas Box" {
        w362 = "Histogram Fan 1 RPM"  # State
        call "Read_XML_Part.gviweb"(Input XML=s2, Start XML Part="<Histogram_gas_box_-_Temperature_profile_Celsius>", End XML Part="</Histogram_gas_box_-_Temperature_profile_Celsius>", Error in=no error) -> (Output XML array=w363, Error out=w364)
        call "Exlude_WA_Entrys.gviweb"(Input XML array=w363, Error in=w364) -> (Without_WA_Entrys=w365, Output Error=w366)
        call "Interpret_Histogram_CPU_IO_Temperature.gviweb"(Histogramm Entrys=w365, Error Cluster input=w366) -> (Signal=w367, Error Output=w2)
        $"Histogram gas box Temperature profile Celsius" <- w367
        w3 = w362
        w4 = s2
        w5 = s3
        w6 = s4
        w7 = s5
        w8 = s6
        w9 = s7
        w10 = s8
      }
      frame "Histogram Fan 1 RPM" {
        w368 = "Histogram Fan 1 Power"  # State
        call "Read_XML_Part.gviweb"(Input XML=s2, Start XML Part="<Histogram_fan_1_-_RPM_profile_1_min>", End XML Part="</Histogram_fan_1_-_RPM_profile_1_min>", Error in=no error) -> (Output XML array=w369, Error out=w370)
        call "Exlude_WA_Entrys.gviweb"(Input XML array=w369, Error in=w370) -> (Without_WA_Entrys=w371, Output Error=w372)
        call "Interpret_Histogram_CPU_IO_Temperature.gviweb"(Histogramm Entrys=w371, Error Cluster input=w372) -> (Signal=w373, Error Output=w2)
        $"Histogram fan 1 RPM profile 1 min" <- w373
        w3 = w368
        w4 = s2
        w5 = s3
        w6 = s4
        w7 = s5
        w8 = s6
        w9 = s7
        w10 = s8
      }
      frame "Update Tab View" {
        call "Trim Whitespace.gvi"(string=$"Common Information_Error") -> (trimmed string=w374)
        call "Trim Whitespace.gvi"(string=$Basic_Settings_Error) -> (trimmed string=w375)
        call "Trim Whitespace.gvi"(string=$"Diagnostic Real Time Data Sensors") -> (trimmed string=w376)
        call "Trim Whitespace.gvi"(string=$"Diagnostic RT Calibration_Text") -> (trimmed string=w377)
        call "Trim Whitespace.gvi"(string=$"Diagnostic Water iCS Switch Text") -> (trimmed string=w378)
        call "Trim Whitespace.gvi"(string=$"Diagnostic Service History Text") -> (trimmed string=w379)
        call "Trim Whitespace.gvi"(string=$"Diagnostic Running Time Components") -> (trimmed string=w380)
        call "Trim Whitespace.gvi"(string=$"Diagnostic RunningTimes mode") -> (trimmed string=w381)
        call "Trim Whitespace.gvi"(string=$"System Logger_Text") -> (trimmed string=w382)
        Concatenate Strings("ℹ (Tab with errors):", ";", w374, ";", w375, ";", w376, ";", w377, ";", w378, ";", w379, ";", w380, ";", w381, ";", w382) -> w383
        call "Trim Whitespace.gvi"(string=w383) -> (trimmed string=w384)
        call "Search and Replace Pattern.gvi"(string=w384, pattern=";;", replace string=";", replace all=TRUE) -> (result string=w385)
        call "Search and Replace Pattern.gvi"(string=w385, pattern=";", replace string="\r\n", replace all=TRUE) -> (result string=w386)
        $"Tabs with errors" <- w386
        w387 = "Wait For Interaction"  # State
        Property Node(instance in=reference to "Tabs with errors", "Visible"=TRUE, error in=no error) -> (error out=w388, instance out=w389)
        Close Reference(error in=w388, reference=w389) -> (error out=w2)
        w3 = w387
        w4 = s2
        w5 = s3
        w6 = s4
        w7 = s5
        w8 = s6
        w9 = s7
        w10 = s8
      }
      frame "Histogram Fan 1 Power" {
        w390 = "Histogram Fan 1 Temperature"  # State
        call "Read_XML_Part.gviweb"(Input XML=s2, Start XML Part="<Histogram_fan_1_-_power_profile_W>", End XML Part="</Histogram_fan_1_-_power_profile_W>", Error in=no error) -> (Output XML array=w391, Error out=w392)
        call "Exlude_WA_Entrys.gviweb"(Input XML array=w391, Error in=w392) -> (Without_WA_Entrys=w393, Output Error=w394)
        call "Interpret_Histogram_CPU_IO_Temperature.gviweb"(Histogramm Entrys=w393, Error Cluster input=w394) -> (Signal=w395, Error Output=w2)
        $"Histogram fan 1 power profile W" <- w395
        w3 = w390
        w4 = s2
        w5 = s3
        w6 = s4
        w7 = s5
        w8 = s6
        w9 = s7
        w10 = s8
      }
      frame "Histogram Fan 1 Temperature" {
        w396 = "Histogram Fan 1 Voltage min"  # State
        call "Read_XML_Part.gviweb"(Input XML=s2, Start XML Part="<Histogram_fan_1_-_Temperature_profile_Celsius>", End XML Part="</Histogram_fan_1_-_Temperature_profile_Celsius>", Error in=no error) -> (Output XML array=w397, Error out=w398)
        call "Exlude_WA_Entrys.gviweb"(Input XML array=w397, Error in=w398) -> (Without_WA_Entrys=w399, Output Error=w400)
        call "Interpret_Histogram_CPU_IO_Temperature.gviweb"(Histogramm Entrys=w399, Error Cluster input=w400) -> (Signal=w401, Error Output=w2)
        $"Histogram fan 1 Temperature_profile Celsius" <- w401
        w3 = w396
        w4 = s2
        w5 = s3
        w6 = s4
        w7 = s5
        w8 = s6
        w9 = s7
        w10 = s8
      }
      frame "Histogram Fan 1 Voltage min" {
        w402 = "Histogram Fan 1 Voltage max"  # State
        call "Read_XML_Part.gviweb"(Input XML=s2, Start XML Part="<Histogram_fan_1_-_Voltage_min_V_-_1phase_3phase>", End XML Part="</Histogram_fan_1_-_Voltage_min_V_-_1phase_3phase>", Error in=no error) -> (Output XML array=w403, Error out=w404)
        call "Exlude_WA_Entrys.gviweb"(Input XML array=w403, Error in=w404) -> (Without_WA_Entrys=w405, Output Error=w406)
        call "Interpret_Histogram_CPU_IO_Temperature.gviweb"(Histogramm Entrys=w405, Error Cluster input=w406) -> (Signal=w407, Error Output=w2)
        $"Histogram fan 1 Voltage min_V_1phase_3phase" <- w407
        w3 = w402
        w4 = s2
        w5 = s3
        w6 = s4
        w7 = s5
        w8 = s6
        w9 = s7
        w10 = s8
      }
      frame "Histogram Fan 1 Voltage max" {
        w408 = "Histogram Fan 2 RPM"  # State
        call "Read_XML_Part.gviweb"(Input XML=s2, Start XML Part="<Histogram_fan_1_-_Voltage_min_V_-_1phase_3phase>", End XML Part="</Histogram_fan_1_-_Voltage_min_V_-_1phase_3phase>", Error in=no error) -> (Output XML array=w409, Error out=w410)
        call "Exlude_WA_Entrys.gviweb"(Input XML array=w409, Error in=w410) -> (Without_WA_Entrys=w411, Output Error=w412)
        call "Interpret_Histogram_CPU_IO_Temperature.gviweb"(Histogramm Entrys=w411, Error Cluster input=w412) -> (Signal=w413, Error Output=w2)
        $"Histogram fan 1 Voltage max_V_1phase_3phase" <- w413
        w3 = w408
        w4 = s2
        w5 = s3
        w6 = s4
        w7 = s5
        w8 = s6
        w9 = s7
        w10 = s8
      }
      frame "Histogram Fan 2 RPM" {
        w414 = "Histogram Fan 2 Power"  # State
        call "Read_XML_Part.gviweb"(Input XML=s2, Start XML Part="<Histogram_fan_2_-_RPM_profile_1_min>", End XML Part="</Histogram_fan_2_-_RPM_profile_1_min>", Error in=no error) -> (Output XML array=w415, Error out=w416)
        call "Exlude_WA_Entrys.gviweb"(Input XML array=w415, Error in=w416) -> (Without_WA_Entrys=w417, Output Error=w418)
        call "Interpret_Histogram_CPU_IO_Temperature.gviweb"(Histogramm Entrys=w417, Error Cluster input=w418) -> (Signal=w419, Error Output=w2)
        $"Histogram fan 2 RPM profile 1 min" <- w419
        w3 = w414
        w4 = s2
        w5 = s3
        w6 = s4
        w7 = s5
        w8 = s6
        w9 = s7
        w10 = s8
      }
      frame "Histogram Fan 2 Power" {
        w420 = "Histogram Fan 2 Temperature"  # State
        call "Read_XML_Part.gviweb"(Input XML=s2, Start XML Part="<Histogram_fan_2_-_power_profile_W>", End XML Part="</Histogram_fan_2_-_power_profile_W>", Error in=no error) -> (Output XML array=w421, Error out=w422)
        call "Exlude_WA_Entrys.gviweb"(Input XML array=w421, Error in=w422) -> (Without_WA_Entrys=w423, Output Error=w424)
        call "Interpret_Histogram_CPU_IO_Temperature.gviweb"(Histogramm Entrys=w423, Error Cluster input=w424) -> (Signal=w425, Error Output=w2)
        $"Histogram fan 2 power profile W" <- w425
        w3 = w420
        w4 = s2
        w5 = s3
        w6 = s4
        w7 = s5
        w8 = s6
        w9 = s7
        w10 = s8
      }
      frame "Histogram Fan 2 Temperature" {
        w426 = "Histogram Fan 2 Voltage min"  # State
        call "Read_XML_Part.gviweb"(Input XML=s2, Start XML Part="<Histogram_fan_2_-_Temperature_profile_Celsius>", End XML Part="</Histogram_fan_2_-_Temperature_profile_Celsius>", Error in=no error) -> (Output XML array=w427, Error out=w428)
        call "Exlude_WA_Entrys.gviweb"(Input XML array=w427, Error in=w428) -> (Without_WA_Entrys=w429, Output Error=w430)
        call "Interpret_Histogram_CPU_IO_Temperature.gviweb"(Histogramm Entrys=w429, Error Cluster input=w430) -> (Signal=w431, Error Output=w2)
        $"Histogram fan 2 Temperature_profile Celsius" <- w431
        w3 = w426
        w4 = s2
        w5 = s3
        w6 = s4
        w7 = s5
        w8 = s6
        w9 = s7
        w10 = s8
      }
      frame "Histogram Fan 2 Voltage min" {
        w432 = "Histogram Fan 2 Voltage max"  # State
        call "Read_XML_Part.gviweb"(Input XML=s2, Start XML Part="<Histogram_fan_2_-_Voltage_min_V_-_1phase_3phase>", End XML Part="</Histogram_fan_2_-_Voltage_min_V_-_1phase_3phase>", Error in=no error) -> (Output XML array=w433, Error out=w434)
        call "Exlude_WA_Entrys.gviweb"(Input XML array=w433, Error in=w434) -> (Without_WA_Entrys=w435, Output Error=w436)
        call "Interpret_Histogram_CPU_IO_Temperature.gviweb"(Histogramm Entrys=w435, Error Cluster input=w436) -> (Signal=w437, Error Output=w2)
        $"Histogram fan 2 Voltage min_V_1phase_3phase" <- w437
        w3 = w432
        w4 = s2
        w5 = s3
        w6 = s4
        w7 = s5
        w8 = s6
        w9 = s7
        w10 = s8
      }
      frame "Histogram Fan 2 Voltage max" {
        w438 = "Histogram Fan 3 RPM"  # State
        call "Read_XML_Part.gviweb"(Input XML=s2, Start XML Part="<Histogram_fan_2_-_Voltage_max_V_-_1phase_3phase>", End XML Part="</Histogram_fan_2_-_Voltage_max_V_-_1phase_3phase>", Error in=no error) -> (Output XML array=w439, Error out=w440)
        call "Exlude_WA_Entrys.gviweb"(Input XML array=w439, Error in=w440) -> (Without_WA_Entrys=w441, Output Error=w442)
        call "Interpret_Histogram_CPU_IO_Temperature.gviweb"(Histogramm Entrys=w441, Error Cluster input=w442) -> (Signal=w443, Error Output=w2)
        $"Histogram fan 2 Voltage max_V_1phase_3phase" <- w443
        w3 = w438
        w4 = s2
        w5 = s3
        w6 = s4
        w7 = s5
        w8 = s6
        w9 = s7
        w10 = s8
      }
      frame "Histogram Fan 3 RPM" {
        w444 = "Histogram Fan 3 Power"  # State
        call "Read_XML_Part.gviweb"(Input XML=s2, Start XML Part="<Histogram_fan_3_-_RPM_profile_1_min>", End XML Part="</Histogram_fan_3_-_RPM_profile_1_min>", Error in=no error) -> (Output XML array=w445, Error out=w446)
        call "Exlude_WA_Entrys.gviweb"(Input XML array=w445, Error in=w446) -> (Without_WA_Entrys=w447, Output Error=w448)
        call "Interpret_Histogram_CPU_IO_Temperature.gviweb"(Histogramm Entrys=w447, Error Cluster input=w448) -> (Signal=w449, Error Output=w2)
        $"Histogram fan 3 RPM profile 1 min" <- w449
        w3 = w444
        w4 = s2
        w5 = s3
        w6 = s4
        w7 = s5
        w8 = s6
        w9 = s7
        w10 = s8
      }
      frame "Histogram Fan 3 Power" {
        w450 = "Histogram Fan 3 Temperature"  # State
        call "Read_XML_Part.gviweb"(Input XML=s2, Start XML Part="<Histogram_fan_3_-_power_profile_W>", End XML Part="</Histogram_fan_3_-_power_profile_W>", Error in=no error) -> (Output XML array=w451, Error out=w452)
        call "Exlude_WA_Entrys.gviweb"(Input XML array=w451, Error in=w452) -> (Without_WA_Entrys=w453, Output Error=w454)
        call "Interpret_Histogram_CPU_IO_Temperature.gviweb"(Histogramm Entrys=w453, Error Cluster input=w454) -> (Signal=w455, Error Output=w2)
        $"Histogram fan 3 power profile W" <- w455
        w3 = w450
        w4 = s2
        w5 = s3
        w6 = s4
        w7 = s5
        w8 = s6
        w9 = s7
        w10 = s8
      }
      frame "Histogram Fan 3 Temperature" {
        w456 = "Histogram Fan 3 Voltage min"  # State
        call "Read_XML_Part.gviweb"(Input XML=s2, Start XML Part="<Histogram_fan_3_-_Temperature_profile_Celsius>", End XML Part="</Histogram_fan_3_-_Temperature_profile_Celsius>", Error in=no error) -> (Output XML array=w457, Error out=w458)
        call "Exlude_WA_Entrys.gviweb"(Input XML array=w457, Error in=w458) -> (Without_WA_Entrys=w459, Output Error=w460)
        call "Interpret_Histogram_CPU_IO_Temperature.gviweb"(Histogramm Entrys=w459, Error Cluster input=w460) -> (Signal=w461, Error Output=w2)
        $"Histogram fan 3 Temperature_profile Celsius" <- w461
        w3 = w456
        w4 = s2
        w5 = s3
        w6 = s4
        w7 = s5
        w8 = s6
        w9 = s7
        w10 = s8
      }
      frame "Histogram Fan 3 Voltage min" {
        w462 = "Histogram Fan 3 Voltage max"  # State
        call "Read_XML_Part.gviweb"(Input XML=s2, Start XML Part="<Histogram_fan_3_-_Voltage_min_V_-_1phase_3phase>", End XML Part="</Histogram_fan_3_-_Voltage_min_V_-_1phase_3phase>", Error in=no error) -> (Output XML array=w463, Error out=w464)
        call "Exlude_WA_Entrys.gviweb"(Input XML array=w463, Error in=w464) -> (Without_WA_Entrys=w465, Output Error=w466)
        call "Interpret_Histogram_CPU_IO_Temperature.gviweb"(Histogramm Entrys=w465, Error Cluster input=w466) -> (Signal=w467, Error Output=w2)
        $"Histogram fan 3 Voltage min_V_1phase_3phase" <- w467
        w3 = w462
        w4 = s2
        w5 = s3
        w6 = s4
        w7 = s5
        w8 = s6
        w9 = s7
        w10 = s8
      }
      frame "Histogram Fan 3 Voltage max" {
        w468 = "Histogram MMI CPU Load"  # State
        call "Read_XML_Part.gviweb"(Input XML=s2, Start XML Part="<Histogram_fan_3_-_Voltage_max_V_-_1phase_3phase>", End XML Part="</Histogram_fan_3_-_Voltage_max_V_-_1phase_3phase>", Error in=no error) -> (Output XML array=w469, Error out=w470)
        call "Exlude_WA_Entrys.gviweb"(Input XML array=w469, Error in=w470) -> (Without_WA_Entrys=w471, Output Error=w472)
        call "Interpret_Histogram_CPU_IO_Temperature.gviweb"(Histogramm Entrys=w471, Error Cluster input=w472) -> (Signal=w473, Error Output=w2)
        $"Histogram fan 3 Voltage max_V_1phase_3phase" <- w473
        w3 = w468
        w4 = s2
        w5 = s3
        w6 = s4
        w7 = s5
        w8 = s6
        w9 = s7
        w10 = s8
      }
      frame "Histogram MMI CPU Load" {
        w474 = "Histogram MMI RAM Load"  # State
        call "Read_XML_Part.gviweb"(Input XML=s2, Start XML Part="<Histogram_-_MMI_CPU_Load_Percent>", End XML Part="</Histogram_-_MMI_CPU_Load_Percent>", Error in=no error) -> (Output XML array=w475, Error out=w476)
        call "Exlude_WA_Entrys.gviweb"(Input XML array=w475, Error in=w476) -> (Without_WA_Entrys=w477, Output Error=w478)
        call "Interpret_Histogram_CPU_IO_Temperature.gviweb"(Histogramm Entrys=w477, Error Cluster input=w478) -> (Signal=w479, Error Output=w2)
        $"Histogram MMI CPU Load Percent" <- w479
        w3 = w474
        w4 = s2
        w5 = s3
        w6 = s4
        w7 = s5
        w8 = s6
        w9 = s7
        w10 = s8
      }
      frame "Histogram MMI RAM Load" {
        w480 = "Histogram Basis CPU Load"  # State
        call "Read_XML_Part.gviweb"(Input XML=s2, Start XML Part="<Histogram_-_MMI_RAM_Load_Percent>", End XML Part="</Histogram_-_MMI_RAM_Load_Percent>", Error in=no error) -> (Output XML array=w481, Error out=w482)
        call "Exlude_WA_Entrys.gviweb"(Input XML array=w481, Error in=w482) -> (Without_WA_Entrys=w483, Output Error=w484)
        call "Interpret_Histogram_CPU_IO_Temperature.gviweb"(Histogramm Entrys=w483, Error Cluster input=w484) -> (Signal=w485, Error Output=w2)
        $"Histogram MMI RAM Load Percent" <- w485
        w3 = w480
        w4 = s2
        w5 = s3
        w6 = s4
        w7 = s5
        w8 = s6
        w9 = s7
        w10 = s8
      }
      frame "Histogram Basis CPU Load" {
        w486 = "Histogram Basis RAM Load"  # State
        call "Read_XML_Part.gviweb"(Input XML=s2, Start XML Part="<Histogram_-_Basis_CPU_Load_Percent>", End XML Part="</Histogram_-_Basis_CPU_Load_Percent>", Error in=no error) -> (Output XML array=w487, Error out=w488)
        call "Exlude_WA_Entrys.gviweb"(Input XML array=w487, Error in=w488) -> (Without_WA_Entrys=w489, Output Error=w490)
        call "Interpret_Histogram_CPU_IO_Temperature.gviweb"(Histogramm Entrys=w489, Error Cluster input=w490) -> (Signal=w491, Error Output=w2)
        $"Histogram Basis CPU Load Percent" <- w491
        w3 = w486
        w4 = s2
        w5 = s3
        w6 = s4
        w7 = s5
        w8 = s6
        w9 = s7
        w10 = s8
      }
      frame "Histogram Basis RAM Load" {
        w492 = "Histogram Magnetron Top Temperature"  # State
        call "Read_XML_Part.gviweb"(Input XML=s2, Start XML Part="<Histogram_-_Basis_RAM_Load_Percent>", End XML Part="</Histogram_-_Basis_RAM_Load_Percent>", Error in=no error) -> (Output XML array=w493, Error out=w494)
        call "Exlude_WA_Entrys.gviweb"(Input XML array=w493, Error in=w494) -> (Without_WA_Entrys=w495, Output Error=w496)
        call "Interpret_Histogram_CPU_IO_Temperature.gviweb"(Histogramm Entrys=w495, Error Cluster input=w496) -> (Signal=w497, Error Output=w2)
        $"Histogram Basis RAM Load Percent" <- w497
        w3 = w492
        w4 = s2
        w5 = s3
        w6 = s4
        w7 = s5
        w8 = s6
        w9 = s7
        w10 = s8
      }
      frame "Histogram Magnetron Top Temperature" {
        w498 = "Histogram Magnetron bottomTemperature"  # State
        call "Read_XML_Part.gviweb"(Input XML=s2, Start XML Part="<Histogram_Magnetron_Top_Temperature_profile_Celsius>", End XML Part="</Histogram_Magnetron_Top_Temperature_profile_Celsius>", Error in=no error) -> (Output XML array=w499, Error out=w500)
        call "Exlude_WA_Entrys.gviweb"(Input XML array=w499, Error in=w500) -> (Without_WA_Entrys=w501, Output Error=w502)
        call "Interpret_Histogram_CPU_IO_Temperature.gviweb"(Histogramm Entrys=w501, Error Cluster input=w502) -> (Signal=w503, Error Output=w2)
        $"Histogram Magnetron Top Temperatur profile Celsius" <- w503
        w3 = w498
        w4 = s2
        w5 = s3
        w6 = s4
        w7 = s5
        w8 = s6
        w9 = s7
        w10 = s8
      }
      frame "Histogram Magnetron bottomTemperature" {
        w504 = "Histogram Power Supply Top Temperature"  # State
        call "Read_XML_Part.gviweb"(Input XML=s2, Start XML Part="<Histogram_Magnetron_bottom_Temperature_profile_Celsius>", End XML Part="</Histogram_Magnetron_bottom_Temperature_profile_Celsius>", Error in=no error) -> (Output XML array=w505, Error out=w506)
        call "Exlude_WA_Entrys.gviweb"(Input XML array=w505, Error in=w506) -> (Without_WA_Entrys=w507, Output Error=w508)
        call "Interpret_Histogram_CPU_IO_Temperature.gviweb"(Histogramm Entrys=w507, Error Cluster input=w508) -> (Signal=w509, Error Output=w2)
        $"Histogram Magnetron bottom Temperature profile Celsius" <- w509
        w3 = w504
        w4 = s2
        w5 = s3
        w6 = s4
        w7 = s5
        w8 = s6
        w9 = s7
        w10 = s8
      }
      frame "Histogram Power Supply Top Temperature" {
        w510 = "Histogram Power Supply bottom Temperature"  # State
        w511 = "</Histogram_Microwave_Power_Supply_Top_Temperature_profile_Celsius>"
        # New part name
        w512 = "<Histogram_Microwave_Power_Supply_Top_Temperature_profile_Celsius>"
        # old part name
        call "Read_XML_Part.gviweb"(Input XML=s2, Start XML Part="<Histogram_Power_Supply_Top_Temperature_profile_Celsius>", End XML Part="</Histogram_Power_Supply_Top_Temperature_profile_Celsius>", Error in=no error) -> (Output XML array=w513, Error out=w514)
        Is Empty Array(array=w513) -> w515
        case (w515) {
          frame False, Default {
            w516 = w514
            w517 = w513
          }
          frame True {
            call "Read_XML_Part.gviweb"(Input XML=s2, Start XML Part=w512, End XML Part=w511, Error in=w514) -> (Output XML array=w517, Error out=w516)
          }
        }
        call "Exlude_WA_Entrys.gviweb"(Input XML array=w517, Error in=w516) -> (Without_WA_Entrys=w518, Output Error=w519)
        call "Interpret_Histogram_CPU_IO_Temperature.gviweb"(Histogramm Entrys=w518, Error Cluster input=w519) -> (Signal=w520, Error Output=w2)
        $"Histogram Power Supply Top Temperature profile Celsius" <- w520
        w3 = w510
        w4 = s2
        w5 = s3
        w6 = s4
        w7 = s5
        w8 = s6
        w9 = s7
        w10 = s8
      }
      frame "Histogram Power Supply bottom Temperature" {
        w521 = "Software Version History"  # State
        w522 = "</Histogram_Microwave_Power_Supply_bottom_Temperature_profile_Celsius>"
        w523 = "<Histogram_Microwave_Power_Supply_bottom_Temperature_profile_Celsius>"
        w524 = "</Histogram_Power_Supply_bottom_Temperature_profile_Celsius>"
        w525 = "<Histogram_Power_Supply_bottom_Temperature_profile_Celsius>"
        call "Read_XML_Part.gviweb"(Input XML=s2, Start XML Part=w525, End XML Part=w524, Error in=no error) -> (Output XML array=w526, Error out=w527)
        Is Empty Array(array=w526) -> w528
        case (w528) {
          frame False, Default {
            w529 = w527
            w530 = w526
          }
          frame True {
            call "Read_XML_Part.gviweb"(Input XML=s2, Start XML Part=w523, End XML Part=w522, Error in=w527) -> (Output XML array=w530, Error out=w529)
          }
        }
        call "Exlude_WA_Entrys.gviweb"(Input XML array=w530, Error in=w529) -> (Without_WA_Entrys=w531, Output Error=w532)
        call "Interpret_Histogram_CPU_IO_Temperature.gviweb"(Histogramm Entrys=w531, Error Cluster input=w532) -> (Signal=w533, Error Output=w2)
        $"Histogram Power Supply bottom Temperature profile Celsius" <- w533
        w3 = w521
        w4 = s2
        w5 = s3
        w6 = s4
        w7 = s5
        w8 = s6
        w9 = s7
        w10 = s8
      }
      frame "Diagnostic Running Times Modes" {
        w534 = "Diagnostic Running Times Comp"  # State
        call "Read_XML_Part.gviweb"(Input XML=s2, Start XML Part="<Diagnostic-RunningTimes-Modes>", End XML Part="</Diagnostic-RunningTimes-Modes>", Error in=no error) -> (Output XML array=w535, Error out=w536)
        call "Exlude_WA_Entrys.gviweb"(Input XML array=w535, Error in=w536) -> (Without_WA_Entrys=w537, Output Error=w538)
        call "Interpret_Diagnostic_RunningTimes_Modes.gviweb"(Diagnostic Service History Entrys=w537, Error Cluster input=w538) -> (Diagnostic Running Time Modes Output=w539, Total running time=w7, Only Total running Time:=w540, Error Cluster output=w541)
        call "Sort_Diagnostic_RunningTimes_Modes.gviweb"(Error_Selektor=$Error_Selektor, Diagnostic Running Time Modes=w539, Input Error=w541) -> (Output=w542, Diagnostic Running Time Components=w543, Output Error=w2)
        $"Diagnostic Running Times Modes" <- w542
        $"Diagnostic RunningTimes mode" <- w543
        $"Total Running Time :" <- w540
        w3 = w534
        w4 = s2
        w5 = s3
        w6 = s4
        w8 = s6
        w9 = s7
        w10 = s8
      }
      frame "Diagnostic Running Times Modes iVario " {
        w544 = "Diagnostic Running Times Component iVario "  # State
        call "Read_XML_Part.gviweb"(Input XML=s2, Start XML Part="<Diagnostic-RunningTimes-Modes>", End XML Part="</Diagnostic-RunningTimes-Modes>", Error in=no error) -> (Output XML array=w545, Error out=w546)
        call "Exlude_WA_Entrys.gviweb"(Input XML array=w545, Error in=w546) -> (Without_WA_Entrys=w547, Output Error=w548)
        call "Interpret_Diagnostic_RunningTimes_Modes.gviweb"(Diagnostic Service History Entrys=w547, Error Cluster input=w548) -> (Total running time=w7, Only Total running Time:=w549, Error Cluster output=w2)
        $"Total Running Time:" <- w549
        w3 = w544
        w4 = s2
        w5 = s3
        w6 = s4
        w8 = s6
        w9 = s7
        w10 = s8
      }
    }
    next s1 = w3
    next s2 = w4
    next s3 = w5
    next s4 = w6
    next s5 = w7
    next s6 = w8
    next s7 = w9
    next s8 = w10
    stop if FALSE
  }
